# Grasshopper definition stairsgh.gh (Grasshopper 1.0.8)

point = Point(Point(67.29938941, 1.317029679, 0.2))
point_2 = Point(Point(70.6387278, 1.317029679, 0.2))
point_3 = Point(Point(85.34938941, 1.317029679, 0.2))
point_4 = Point(Point(64.24938943, 1.317029679, 0.2))
point_5 = Point(Point(73.68872779, 1.317029679, 0.2))
point_6 = Point(Point(88.3993894, 1.317029679, 0.2))
point_7 = Point(Point(82.29938943, 1.317029679, 0.2))

point_8 = Point(Point(91.07438945, 7.117029679, 0.2))
point_9 = Point(Point(66.12438944, 7.117029679, 0.2))

deconstruct = Deconstruct(Point=point_9)  # -> XComponent, YComponent, ZComponent
deconstruct_2 = Deconstruct(Point=point_8)  # -> XComponent, YComponent, ZComponent
deconstruct_3 = Deconstruct(Point=point_5)  # -> XComponent, YComponent, ZComponent
deconstruct_4 = Deconstruct(Point=point_2)  # -> XComponent, YComponent, ZComponent
deconstruct_5 = Deconstruct(Point=point_4)  # -> XComponent, YComponent, ZComponent
deconstruct_6 = Deconstruct(Point=point_7)  # -> XComponent, YComponent, ZComponent
deconstruct_7 = Deconstruct(Point=point_3)  # -> XComponent, YComponent, ZComponent
deconstruct_8 = Deconstruct(Point=point_6)  # -> XComponent, YComponent, ZComponent
deconstruct_9 = Deconstruct(Point=point)  # -> XComponent, YComponent, ZComponent
merge = Merge(Data1=deconstruct.XComponent, Data2=deconstruct.YComponent)
merge_2 = Merge(Data1=deconstruct_4.XComponent, Data2=deconstruct_4.YComponent)
merge_3 = Merge(Data1=deconstruct_2.XComponent, Data2=deconstruct_2.YComponent)
merge_4 = Merge(Data1=deconstruct_5.XComponent, Data2=deconstruct_5.YComponent)
merge_5 = Merge(Data1=deconstruct_3.XComponent, Data2=deconstruct_3.YComponent)
merge_6 = Merge(Data1=deconstruct_6.XComponent, Data2=deconstruct_6.YComponent)
merge_7 = Merge(Data1=deconstruct_9.XComponent, Data2=deconstruct_9.YComponent)
merge_8 = Merge(Data1=deconstruct_7.XComponent, Data2=deconstruct_7.YComponent)
merge_9 = Merge(Data1=deconstruct_8.XComponent, Data2=deconstruct_8.YComponent)
panel = Panel(merge)
panel_2 = Panel(merge_3)
panel_3 = Panel(merge_2)
panel_4 = Panel(merge_4)
panel_5 = Panel(merge_5)
panel_6 = Panel(merge_6)
panel_7 = Panel(merge_7)
panel_8 = Panel(merge_8)
panel_9 = Panel(merge_9)
